# Grasshopper definition 00_calculator_hs26_solution.gh (Grasshopper 1.0.8)

# ----
# Ungraded assignment: Mini Calculator
# Main Task
# The task is to create a simple calculator program that can perform four basic arithmetic operations: addition, subtraction, multiplication, and division. The calculator could also handle division by zero and invalid operations.
# 
# The calculator should accept two input numbers and an arithmetic operation from a Grasshopper value list input component. ("addition", "subtraction", "multiplication", "division") Based on the selected operation it should perform the correct arithmetic calculation.
# 
# Optionally, introduce an error handling in case a number is divided by zero or if the operation name is invalid.
# Simple “Mini Calculator”: Version only completing main task
number_slider = Slider(4.725, range=0..10)
# Challenge 01
list = ValueList({"addition": "+", "subtraction": "-", "multiplication": "*", "division": "/"}, selected="addition")
calc = Python3Script(num_01=number_slider, num_02=Slider(3.655, range=0..10), operation=list)  # -> out
# ---------- calc: Python ----------
if operation == "+":
    print(num_01 + num_02)
elif operation == "-":
    print(num_01 - num_02)
elif operation == "*":
    print(num_01 * num_02)
elif operation == "/":
    # There are other options to show the error
    # Only implemented in the challenge 02 version
    if num_02 != 0:
        print(num_01 / num_02)
    else:
        print("Error: Division by zero")
# ---------- end calc ----------
panel = Panel(calc)

# ----
# Simple “Mini Calculator”: Version with challenge 01
# Create more user-friendly messages, that not only display the result but also explain the operation being performed.
# Create a custom print statement for each operation.
# Example: addition: "The result of [num_01] + [num_02] is: [result]"
number_slider_2 = Slider(4.47, range=0..10)
# Challenge 02
list_2 = ValueList({"addition": "+", "subtraction": "-", "multiplication": "*", "division": "/"}, selected="addition")
calc_2 = Python3Script(num_01=number_slider_2, num_02=Slider(0.85, range=0..10), operation=list_2)  # -> out
# ---------- calc_2: Python ----------
if operation == "+":
    result = num_01 + num_02
elif operation == "-":
    result = num_01 - num_02
elif operation == "*":
    result = num_01 * num_02
elif operation == "/":
    # There are other options to show the error
    # Only implemented in the challenge 02 version
    if num_02 != 0:
        result = num_01 / num_02
    else:
        result = "Error"

print(f"The result of {num_01} {operation} {num_02} is {result}")
# ---------- end calc_2 ----------
panel_2 = Panel(calc_2)

# ----
# Increase the readability of the code. Use a set of functions for each operation and one function for the main calculator
# Simple “Mini Calculator”: Version with challenge 02
number_slider_3 = Slider(7.602, range=0..10)
list_3 = ValueList({"addition": "+", "subtraction": "-", "multiplication": "*", "division": "/"}, selected="division")
calc_3 = Python3Script(num_01=number_slider_3, num_02=Slider(1.598, range=0..10), operation=list_3)  # -> out
# ---------- calc_3: Python ----------
def calc(num_01, num_02, operation):
    # Main calc function.
    # It returns the rounded result,
    # or the string "Error!" if it failed.
    if operation == "+":
        result = add(num_01, num_02)
    elif operation == "-":
        result = subtract(num_01, num_02)
    elif operation == "*":
        result = multiply(num_01, num_02)
    elif operation == "/":
        if num_02 == 0:
            return handle_division_by_zero()
        result = divide(num_01, num_02)
    else:
        raise ValueError("Unsupported operation: " + str(operation))

    return round(result, 2)

def add(x, y):
    return x + y

def subtract(x, y):
    return x - y

def multiply(x, y):
    return x * y

def divide(x, y):
    return x / y

def handle_division_by_zero():
    # We can show the error condition in different ways
    # Option 0: do nothing but return an error string
    # This is the lazy option because the component will
    # stay green, as if no error has occurred
    # return "Error!"
    
    # Option 1: raise an exception
    # This causes the component to turn red,
    # which is good because the operation is really invalid
    # but the error message is not very nice for the user
    # raise ValueError("Division by Zero")
    
    # Option 2: use Grasshopper API to show nice error bubble
    # on top of the component.
    # This option uses some features of Grasshopper SDK that are
    # not super well documented, but it allows the nicest
    # way of customizing the result
    from Grasshopper.Kernel import GH_RuntimeMessageLevel
    ghenv.Component.AddRuntimeMessage(GH_RuntimeMessageLevel.Error, "Error")
    return "Error!"


# Here is the point where our scripts starts to run
# (because everything above are function definitions)
# And the only thing we do is call our main `calc` function

result = calc(num_01, num_02, operation)
print(f"The result of {num_01} {operation} {num_02} is {result}")

# Grasshopper also lets us define the text message
# that shows up below the component
ghenv.Component.Message = str(result)
# ---------- end calc_3 ----------
panel_3 = Panel(calc_3)
