# Grasshopper definition 00_hello_world_hs26.gh (Grasshopper 1.0.8)

# ----
# Hello World!
python_3_script = Python3Script()  # -> out, a
# ---------- python_3_script: Python ----------
# r: compas
# venv: ca-hs26

import compas
print("Hello Coding Architecture World!")
print("Using COMPAS version:")
print(compas.__version__)
# ---------- end python_3_script ----------
panel = Panel(python_3_script.out)
