# Grasshopper definition 03-brick-fast-preview.gh (Grasshopper 1.0.8)

brick_pattern = BrickPattern({"Distance", "Concentric ripples", "Interference", "Spiral", "Checkerboard wave", "X silhouette", "Depth wave"}, selected="Distance")
point = Point(Point(25.09574796, -16.54514036, 24.19142423))
python_3_script = Python3Script(attractor_point=point, pattern=brick_pattern)  # -> brick_wall; inputs attractor_point: Point3d
# ---------- python_3_script: Python ----------
# r: compas
# venv: ca-hs26

row_count = 20
column_count = 10
xsize = 1.34
ysize = 0.95
zsize = 0.5
rotation_factor = 50

mortar_gap = 0.05

import math
from compas.geometry import Point
from compas_rhino.conversions import point_to_compas
# ---------- end python_3_script ----------
bricks_preview = Python3Script(bricks=python_3_script)  # -> rg; inputs bricks: list
# ---------- bricks_preview: Python ----------
# r: compas
# venv: ca-hs26

# Resolve support files from the saved definition.
import sys
from pathlib import Path
import Grasshopper
import System

# Find the package beside this Grasshopper file. The package loads its DLL
# relative to its own __file__, so the complete folder can be moved together.
gh_path = ghenv.Component.OnPingDocument().FilePath
if not gh_path:
    raise RuntimeError("Save the Grasshopper definition before loading the preview package.")
package_path = str(Path(gh_path).parent)
if package_path not in sys.path:
    sys.path.insert(0, package_path)
from custom_brick_preview import bricks_to_rhino_mesh

class CompasToRhinoGeometry(Grasshopper.Kernel.GH_ScriptInstance):
    def RunScript(self, bricks: System.Collections.Generic.List[object]):
        return bricks_to_rhino_mesh(bricks)
# ---------- end bricks_preview ----------
