# Grasshopper definition 01-geometry-and-datastructures_hs26.gh (Grasshopper 1.0.8)

# ---- group: 02 Dot product
# Move the angle slider: try 0, 90 and 180 degrees.
# Two vectors, their sum tip, and raw versus unit dot products.
angle_degrees = Slider(90, range=0..180)
vector_arithmetic = Python3Script(angle=angle_degrees)  # -> sum_tip, u, v, report
# ---------- vector_arithmetic: Python ----------
# r: compas
# venv: ca-hs26

import math
from compas.geometry import Point
from compas.geometry import Vector

# Turn the slider and check the result at 0, 90 and 180 degrees first
radians = math.radians(angle)
u = Vector(4, 0, 0)
v = Vector(4 * math.cos(radians), 4 * math.sin(radians), 0)

# The sum tip makes the parallelogram rule visible as a point.
sum_vector = u + v
sum_tip = Point(sum_vector.x, sum_vector.y, sum_vector.z)
dot_raw = u.dot(v)
u_unit = u.unitized()
v_unit = v.unitized()
dot_unit = u_unit.dot(v_unit)
cross = u.cross(v)

report = f"""ANGLE: {angle:.0f} degrees
u.length = {u.length:.1f}; v.length = {v.length:.1f}
dot(raw)  = {dot_raw:.3f}
dot(unit) = {dot_unit:.3f}
cross     = ({cross.x:.1f}, {cross.y:.1f}, {cross.z:.1f})

Try 0 / 90 / 180. Which vectors are parallel?"""
ghenv.Component.Message = f"dot(unit) = {dot_unit:.3f}"
# ---------- end vector_arithmetic ----------
draw = Python3Script(cg=vector_arithmetic.sum_tip)  # -> rg
#   port cg: The COMPAS geometry or datastructure to be drawn.
#   port rg: The Rhino geometry object.
# ---------- draw: Python ----------
# r: compas
# venv: ca-hs26

# Display helper only: move the drawn copy into its gallery station.
# The COMPAS data and teaching calculations keep their original coordinates.
import Rhino
from ghpythonlib.componentbase import executingcomponent as component
from compas.scene import SceneObject

class PreviewAtStation(component):
    def RunScript(self, cg):
        if cg is None:
            return []
        drawn = SceneObject(item=cg).draw()
        shift = Rhino.Geometry.Transform.Translation(-30, 15, 0)
        for geometry in drawn:
            geometry.Transform(shift)
        return drawn
# ---------- end draw ----------
draw_2 = Python3Script(cg=vector_arithmetic.u)  # -> rg; same code as draw
draw_3 = Python3Script(cg=vector_arithmetic.v)  # -> rg; same code as draw
dot_and_cross_products = Panel(vector_arithmetic.report)

# ---- group: 01 Geometry ingredients
# WEEK 07  |  FROM SHAPES TO TOPOLOGY
# Eight experiments: play with the input parameters and inspect the results.
# A point is a location; a polyline is a path; a polygon is a face.
# Open Primitives and change one corner. Which outputs change?
primitives = Python3Script()  # -> point, polyline, polygon
# ---------- primitives: Python ----------
# r: compas
# venv: ca-hs26

from compas.geometry import Frame
from compas.geometry import Plane
from compas.geometry import Point
from compas.geometry import Polygon
from compas.geometry import Polyline
from compas.geometry import Vector

# Point, Vector & Plane
point = Point(0, 0, 0)
vector = Vector(0, 0, 1)
plane = Plane(point, vector)
print(point)
print(vector)
print(plane)

# Frame
xaxis = [1, 0, 0]
yaxis = [0, 1, 0]
frame = Frame(point, xaxis, yaxis)
print(frame)

# Polyline
p1 = [0, 0, 0]
p2 = [1, 0, 0]
p3 = [1, 1, 0]
p4 = [0, 0, 0]
polyline = Polyline([p1, p2, p3, p4])
print(polyline)

# Polygon
polygon = Polygon([p1, p2, p3])
print(polygon)
# ---------- end primitives ----------
draw_4 = Python3Script(cg=primitives.point)  # -> rg
#   port cg: The COMPAS geometry or datastructure to be drawn.
#   port rg: The Rhino geometry object.
# ---------- draw_4: Python ----------
# r: compas
# venv: ca-hs26

# Display helper only: move the drawn copy into its gallery station.
# The COMPAS data and teaching calculations keep their original coordinates.
import Rhino
from ghpythonlib.componentbase import executingcomponent as component
from compas.scene import SceneObject

class PreviewAtStation(component):
    def RunScript(self, cg):
        if cg is None:
            return []
        drawn = SceneObject(item=cg).draw()
        shift = Rhino.Geometry.Transform.Translation(-30, 0, 0)
        for geometry in drawn:
            geometry.Transform(shift)
        return drawn
# ---------- end draw_4 ----------
draw_5 = Python3Script(cg=primitives.polyline)  # -> rg; same code as draw_4
draw_6 = Python3Script(cg=primitives.polygon)  # -> rg; same code as draw_4

# ---- group: 03 Same frame, different construction
# Both constructions describe the same frame. Why?
# Change the point defining f2 and compare the axes.
construct = Python3Script()  # -> v1, v2, f1, f2
# ---------- construct: Python ----------
# r: compas
# venv: ca-hs26

from compas.geometry import Frame
from compas.geometry import Vector

v1 = Vector(1, 0, 0)
v2 = Vector.from_start_end([1, 0, 0], [2, 0, 0])
print("Are the two vectors equal?", v1 == v2)

f1 = Frame([0, 0, 0], [3, 0, 0], [0, 2, 0])
f2 = Frame.from_points([0, 0, 0], [5, 0, 0], [1, 2, 0])
print("Are the two frames equal?", f1 == f2)
# ---------- end construct ----------
draw_7 = Python3Script(cg=construct.v1)  # -> rg
#   port cg: The COMPAS geometry or datastructure to be drawn.
#   port rg: The Rhino geometry object.
# ---------- draw_7: Python ----------
# r: compas
# venv: ca-hs26

# Display helper only: move the drawn copy into its gallery station.
# The COMPAS data and teaching calculations keep their original coordinates.
import Rhino
from ghpythonlib.componentbase import executingcomponent as component
from compas.scene import SceneObject

class PreviewAtStation(component):
    def RunScript(self, cg):
        if cg is None:
            return []
        drawn = SceneObject(item=cg).draw()
        shift = Rhino.Geometry.Transform.Translation(-30, 30, 0)
        for geometry in drawn:
            geometry.Transform(shift)
        return drawn
# ---------- end draw_7 ----------
draw_8 = Python3Script(cg=construct.v2)  # -> rg; same code as draw_7
draw_9 = Python3Script(cg=construct.f1)  # -> rg; same code as draw_7
draw_10 = Python3Script(cg=construct.f2)  # -> rg; same code as draw_7

# ---- group: 04 Move a copy
# transformed() makes a new point: the original stays put.
# Change the translation vector and predict p2 before solving.
transform = Python3Script()  # -> p1, p2
# ---------- transform: Python ----------
# r: compas
# venv: ca-hs26

from compas.geometry import Point
from compas.geometry import Translation

p1 = Point(1, 0, 0)

# translate
t = Translation.from_vector([5, 1, 0])
p2 = p1.transformed(t)
# ---------- end transform ----------
draw_11 = Python3Script(cg=transform.p1)  # -> rg
#   port cg: The COMPAS geometry or datastructure to be drawn.
#   port rg: The Rhino geometry object.
# ---------- draw_11: Python ----------
# r: compas
# venv: ca-hs26

# Display helper only: move the drawn copy into its gallery station.
# The COMPAS data and teaching calculations keep their original coordinates.
import Rhino
from ghpythonlib.componentbase import executingcomponent as component
from compas.scene import SceneObject

class PreviewAtStation(component):
    def RunScript(self, cg):
        if cg is None:
            return []
        drawn = SceneObject(item=cg).draw()
        shift = Rhino.Geometry.Transform.Translation(-30, 45, 0)
        for geometry in drawn:
            geometry.Transform(shift)
        return drawn
# ---------- end draw_11 ----------
draw_12 = Python3Script(cg=transform.p2)  # -> rg; same code as draw_11

# ---- group: 05 Shapes and dimensions
# A frame positions a shape; its dimensions control its size.
# Box(x, y, z) differs from width / height / depth ordering.
shapes = Python3Script()  # -> b1, s1, c1
# ---------- shapes: Python ----------
# r: compas
# venv: ca-hs26

from compas.geometry import Box
from compas.geometry import Circle
from compas.geometry import Cylinder
from compas.geometry import Frame
from compas.geometry import Plane
from compas.geometry import Sphere

# Box
frame_box = Frame.worldXY()
b1 = Box(5, 1, 3, frame_box)                 # xsize, ysize, zsize
b2 = Box.from_width_height_depth(5, 3, 1)    # width=xsize, height=zsize, depth=ysize
print(b1)

# Sphere
frame_sphere = Frame([20,0,0], [1,0,0], [0,1,0]) 
s1 = Sphere(5, frame_sphere)
print(s1)

# Cylinder
frame_cylinder = Frame([40,0,0], [1,0,0], [0,1,0]) 
c1 = Cylinder(5, 4, frame_cylinder)
print(c1)
# ---------- end shapes ----------
draw_13 = Python3Script(cg=shapes.b1)  # -> rg
#   port cg: The COMPAS geometry or datastructure to be drawn.
#   port rg: The Rhino geometry object.
# ---------- draw_13: Python ----------
# r: compas
# venv: ca-hs26

# Display helper only: move the drawn copy into its gallery station.
# The COMPAS data and teaching calculations keep their original coordinates.
import Rhino
from ghpythonlib.componentbase import executingcomponent as component
from compas.scene import SceneObject

class PreviewAtStation(component):
    def RunScript(self, cg):
        if cg is None:
            return []
        drawn = SceneObject(item=cg).draw()
        shift = Rhino.Geometry.Transform.Translation(-30, 60, 0)
        for geometry in drawn:
            geometry.Transform(shift)
        return drawn
# ---------- end draw_13 ----------
draw_14 = Python3Script(cg=shapes.s1)  # -> rg; same code as draw_13
draw_15 = Python3Script(cg=shapes.c1)  # -> rg; same code as draw_13

# ---- group: 06 Swiss cities: geometric shortest path
# Graph
# Cities are nodes, connections are edges.
# Use graph.shortest_path to find the geometrically shortest route.
# Blue shows the result.
start_city = StartCity({"Basel", "Bern", "Chur", "Genève", "Lausanne", "Lugano", "Luzern", "Sion", "St. Gallen", "Zürich"}, selected="Genève")
destination_city = DestinationCity({"Basel", "Bern", "Chur", "Genève", "Lausanne", "Lugano", "Luzern", "Sion", "St. Gallen", "Zürich"}, selected="St. Gallen")
swiss_city_graph = Python3Script(start_city=start_city, destination_city=destination_city)  # -> graph, report
# ---------- swiss_city_graph: Python ----------
# r: compas
# venv: ca-hs26

from compas.datastructures import Graph

# 1. Add ten Swiss cities at scaled, north-up station positions.
# Positions come from longitude/latitude; the lines are NOT railway tracks.
graph = Graph()
geneva = graph.add_node(x=0.68, y=2.87, z=0, city="Genève")
lausanne = graph.add_node(x=3.01, y=5.02, z=0, city="Lausanne")
bern = graph.add_node(x=6.90, y=8.04, z=0, city="Bern")
basel = graph.add_node(x=7.62, y=12.23, z=0, city="Basel")
zurich = graph.add_node(x=12.17, y=11.05, z=0, city="Zürich")
lucerne = graph.add_node(x=11.07, y=8.75, z=0, city="Luzern")
st_gallen = graph.add_node(x=16.15, y=11.36, z=0, city="St. Gallen")
chur = graph.add_node(x=16.91, y=7.37, z=0, city="Chur")
sion = graph.add_node(x=6.51, y=2.99, z=0, city="Sion")
lugano = graph.add_node(x=14.12, y=1.44, z=0, city="Lugano")

# 2. Connect the cities.
# Edges represent connections, not the actual railway alignment.
graph.add_edge(zurich, basel)
graph.add_edge(zurich, bern)
graph.add_edge(basel, bern)
graph.add_edge(bern, lausanne)
graph.add_edge(lausanne, geneva)
graph.add_edge(zurich, lucerne)
graph.add_edge(lucerne, bern)
graph.add_edge(lucerne, lugano)
graph.add_edge(zurich, st_gallen)
graph.add_edge(st_gallen, chur)
graph.add_edge(zurich, chur)
graph.add_edge(lausanne, sion)
graph.add_edge(sion, bern)
graph.add_edge(basel, lucerne)
graph.add_edge(zurich, lugano)

# 3. Find the shortest path by geometric edge length.
# Match the selected city names to their node keys.
for city_key in graph.nodes():
    city_name = graph.node_attribute(city_key, "city")
    if city_name == start_city:
        start = city_key
    if city_name == destination_city:
        destination = city_key
if start == destination:
    path = [start]
else:
    path = graph.shortest_path(start, destination)

# Weighted paths are also possible with compas.topology.dijkstra_path.

# 4. Read the city names along the path.
city_names = []
for city_key in path:
    city_name = graph.node_attribute(city_key, "city")
    city_names.append(city_name)

route_text = " -> ".join(city_names)

# Pass the path to the drawing helper for the blue highlight.
graph.attributes["shortest_path"] = path

report = f"""GEOMETRIC SHORTEST PATH
{route_text}

Blue = shortest route along the graph edges.
Try changing start or destination."""
print(report)

number_of_cities = graph.number_of_nodes()
number_of_links = graph.number_of_edges()
ghenv.Component.Message = f"{number_of_cities} cities / {number_of_links} links"
# ---------- end swiss_city_graph ----------
map_labels = Python3Script(cg=swiss_city_graph.graph)  # -> rg, colours, label_points, label_text
#   port cg: The COMPAS geometry or datastructure to be drawn.
#   port rg: The Rhino geometry object.
# ---------- map_labels: Python ----------
# r: compas
# venv: ca-hs26

# Display helper: city names and a simplified country outline.
# Outline: Natural Earth 1:50m, simplified, public domain, naturalearthdata.com.
# All drawing offsets are display-only; the graph data are unchanged.
import Rhino
from System.Drawing import Color
from ghpythonlib.componentbase import executingcomponent as component

class SwissCityPreview(component):
    def RunScript(self, cg):
        if cg is None:
            return [], [], [], []

        geometry = []
        colours = []
        label_points = []
        label_text = []
        offset_x = 22
        offset_y = 0

        # Generalised Swiss border in the same scaled map coordinates.
        outline_xy = [[16.887, 12.07], [17.375, 11.669], [17.294, 11.143], [16.696, 9.609], [16.712, 8.836], [17.346, 8.802], [18.426, 8.452], [18.581, 7.964], [19.807, 7.361], [20.029, 7.436], [20.842, 8.293], [21.156, 8.151], [21.346, 7.696], [21.074, 6.055], [21.267, 5.732], [21.231, 5.25],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
        border_points = []
        for coordinates in outline_xy:
            point = Rhino.Geometry.Point3d(coordinates[0] + offset_x, coordinates[1] + offset_y, -0.02)
            border_points.append(point)
        border = Rhino.Geometry.PolylineCurve(border_points)
        geometry.append(border)
        colours.append(Color.FromArgb(175, 175, 175))

        path = cg.attributes.get("shortest_path", [])
        path_edges = []
        for index in range(len(path) - 1):
            city_a = path[index]
            city_b = path[index + 1]
            path_edges.append((city_a, city_b))

        for edge in cg.edges():
            city_a = edge[0]
            city_b = edge[1]
            a = cg.node_coordinates(city_a)
            b = cg.node_coordinates(city_b)
            start = Rhino.Geometry.Point3d(a[0] + offset_x, a[1] + offset_y, 0)
            end = Rhino.Geometry.Point3d(b[0] + offset_x, b[1] + offset_y, 0)
            line = Rhino.Geometry.LineCurve(start, end)
            geometry.append(line)
            if (city_a, city_b) in path_edges or (city_b, city_a) in path_edges:
                colours.append(Color.FromArgb(20, 100, 215))
            else:
                colours.append(Color.FromArgb(110, 125, 140))

        for city_key in cg.nodes():
            coordinates = cg.node_coordinates(city_key)
            point = Rhino.Geometry.Point3d(coordinates[0] + offset_x, coordinates[1] + offset_y, 0.05)
            geometry.append(point)
            colours.append(Color.FromArgb(40, 45, 55))
            city_name = cg.node_attribute(city_key, "city")
            label_point = Rhino.Geometry.Point3d(point.X + 0.15, point.Y + 0.55, 0.05)
            label_points.append(label_point)
            label_text.append(city_name)

        return geometry, colours, label_points, label_text
# ---------- end map_labels ----------
geometric_shortest_path = Panel(swiss_city_graph.report)
city_network = CustomPreview(Geometry=map_labels.rg, Material=map_labels.colours)
city_labels = TextTag(Location=map_labels.label_points, Text=map_labels.label_text, Colour=RGB(35, 40, 50))

# ---- group: 07 Mesh: a canopy surface
# 16 vertices and 9 faces make a surface, not solid cells.
# Move curvature to 0: does geometry or topology change?
canopy_curvature = Slider(0.08, range=-0.15..0.15)
canopy_mesh = Python3Script(curvature=canopy_curvature)  # -> mesh
# ---------- canopy_mesh: Python ----------
# r: compas
# venv: ca-hs26

from compas.datastructures import Mesh

# Curvature comes from the slider. Zero makes the canopy flat.
mesh = Mesh.from_meshgrid(dx=12, nx=3, dy=12, ny=3)
for key in mesh.vertices():
    x, y, z = mesh.vertex_coordinates(key)
    height = curvature * (x - 6) * (y - 6)
    mesh.vertex_attribute(key, "z", height)

number_of_vertices = mesh.number_of_vertices()
number_of_faces = mesh.number_of_faces()
boundary_vertices = mesh.vertices_on_boundary()
unique_boundary_vertices = set(boundary_vertices)
ordered_boundary_vertices = sorted(unique_boundary_vertices)

print(f"Vertices: {number_of_vertices}")
print(f"Faces: {number_of_faces}")
print(f"Boundary vertices: {ordered_boundary_vertices}")
print("Move curvature to 0: what changes, geometry or topology?")
ghenv.Component.Message = f"{number_of_vertices} vertices / {number_of_faces} faces"
# ---------- end canopy_mesh ----------
draw_16 = Python3Script(cg=canopy_mesh)  # -> rg
#   port cg: The COMPAS geometry or datastructure to be drawn.
#   port rg: The Rhino geometry object.
# ---------- draw_16: Python ----------
# r: compas
# venv: ca-hs26

# Display helper only: move the drawn copy into its gallery station.
# The COMPAS data and teaching calculations keep their original coordinates.
import Rhino
from ghpythonlib.componentbase import executingcomponent as component
from compas.scene import SceneObject

class PreviewAtStation(component):
    def RunScript(self, cg):
        if cg is None:
            return []
        drawn = SceneObject(item=cg).draw()
        shift = Rhino.Geometry.Transform.Translation(22, 22, 0)
        for geometry in drawn:
            geometry.Transform(shift)
        return drawn
# ---------- end draw_16 ----------

# ---- group: 08 VolMesh: shared topology
# VolMesh
cell_key = Slider(37, range=0..124)
connected_cells = Python3Script()  # -> vm
# ---------- connected_cells: Python ----------
# r: compas
# venv: ca-hs26

from compas.datastructures import VolMesh

# dx/dy/dz are TOTAL grid dimensions.
vm = VolMesh.from_meshgrid(dx=12, dy=12, dz=4, nx=5)
print("Cells:", vm.number_of_cells())
print("Shared vertices:", vm.number_of_vertices())
ghenv.Component.Message = "{} cells / {} shared vertices".format(vm.number_of_cells(), vm.number_of_vertices())
# ---------- end connected_cells ----------
ask_for_neighbours = Python3Script(vm=connected_cells, i=cell_key)  # -> cell, n, report
# ---------- ask_for_neighbours: Python ----------
# r: compas
# venv: ca-hs26

key = int(i)
neighbours = sorted(set(vm.cell_neighbors(key)))
cell = vm.cell_to_mesh(key)
n = [vm.cell_to_mesh(nbr) for nbr in neighbours]

location = "boundary" if vm.is_cell_on_boundary(key) else "interior"

number_of_cells = vm.number_of_cells()
number_of_vertices = vm.number_of_vertices()
number_of_neighbours = len(neighbours)
unique_faces = len(list(vm.faces()))
half_faces = len(list(vm.halffaces()))

report = f"""GRID: {number_of_cells} cells | {number_of_vertices} shared vertices
{unique_faces} unique faces | {half_faces} half-faces

SELECTED CELL {key}: {number_of_neighbours} neighbours ({location})
Neighbour keys: {neighbours}

Do you know why an internal face has two half-faces?"""

ghenv.Component.Message = f"Cell {key} / {number_of_neighbours} neighbours"
# ---------- end ask_for_neighbours ----------
unique_grid_edges = Python3Script(cg=connected_cells)  # -> rg
#   port cg: The COMPAS geometry or datastructure to be drawn.
#   port rg: The Rhino geometry object.
# ---------- unique_grid_edges: Python ----------
# r: compas
# venv: ca-hs26

# Draw each edge once. The context stays light enough to see inside.
from ghpythonlib.componentbase import executingcomponent as component
from compas_rhino.conversions import line_to_rhino
from compas.geometry import Line

class GridEdges(component):
    def RunScript(self, cg):
        if cg is None:
            return []
        return [line_to_rhino(Line(*cg.edge_coordinates(edge))) for edge in cg.edges()]
# ---------- end unique_grid_edges ----------
draw_17 = Python3Script(cg=ask_for_neighbours.cell)  # -> rg
#   port cg: The COMPAS geometry or datastructure to be drawn.
#   port rg: The Rhino geometry object.
# ---------- draw_17: Python ----------
# r: compas
# venv: ca-hs26

# Convert the cell mesh at its original size; do not transform its vertices.
from ghpythonlib.componentbase import executingcomponent as component
from compas_rhino.conversions import mesh_to_rhino

class CellPreview(component):
    def RunScript(self, cg):
        if cg is None:
            return []
        mesh = mesh_to_rhino(cg)
        return mesh
# ---------- end draw_17 ----------
draw_18 = Python3Script(cg=ask_for_neighbours.n)  # -> rg; same code as draw_17
predict_and_inspect = Panel(ask_for_neighbours.report)
context_colour = ColourSwatch(SwatchColor=RGB(130, 145, 160))
selected_cell_colour = ColourSwatch(SwatchColor=RGB(234, 143, 50))
neighbours_colour = ColourSwatch(SwatchColor=RGBA(49, 155, 178, 105))
context = CustomPreview(Geometry=unique_grid_edges, Material=context_colour)
selected_cell = CustomPreview(Geometry=draw_17, Material=selected_cell_colour)
neighbours = CustomPreview(Geometry=draw_18, Material=neighbours_colour)
