# Grasshopper definition 02-building-grid-tutorial_hs26_solution.gh (Grasshopper 1.0.8)

# ----
# Filters selection
modulo_filter = Python3Script()  # -> mfilter
# ---------- modulo_filter: Python ----------
# r: compas
# venv: ca-hs26

# Sample filter
class ModuleBasedFilter:
    def is_included(self, point, ix, iy, iz):
        if (ix + iy) % 2 == 0:
            return True

        return False

mfilter = ModuleBasedFilter()
# ---------- end modulo_filter ----------
random_filter = Python3Script()  # -> rfilter
# ---------- random_filter: Python ----------
# r: compas
# venv: ca-hs26

# Sample filter
from random import choice

class RandomFilter:
    def is_included(self, point, ix, iy, iz):
        return choice([True, False])

rfilter = RandomFilter()
# ---------- end random_filter ----------
linear_filter = Python3Script()  # -> lfilter
# ---------- linear_filter: Python ----------
# r: compas
# venv: ca-hs26

# Sample filter
class LinearFilter:
    def __init__(self, coefficient=1, vertical_shift_x=0, vertical_shift_y=0, horizontal_shift_x=0, horizontal_shift_y=0):
        super(LinearFilter, self).__init__()
        self.coefficient = coefficient
        self.vertical_shift_x = vertical_shift_x
        self.vertical_shift_y = vertical_shift_y
        self.horizontal_shift_x = horizontal_shift_x
        self.horizontal_shift_y = horizontal_shift_y

    def is_included(self, point, ix, iy, iz):
        z_range_x = (self.coefficient * ix + self.vertical_shift_x) + self.horizontal_shift_x
        z_range_y = (self.coefficient * iy + self.vertical_shift_y) + self.horizontal_shift_y
        return not z_range_x < iz > z_range_y

lfilter = LinearFilter(coefficient= 1.7, vertical_shift_x= -3, vertical_shift_y=-3, horizontal_shift_x=0, horizontal_shift_y=0)
# ---------- end linear_filter ----------
parab_filter = Python3Script()  # -> pfilter
# ---------- parab_filter: Python ----------
# r: compas
# venv: ca-hs26

# Sample filter
class ParaboloidFilter:
    def __init__(self, coefficient, horizontal_shift_x, horizontal_shift_y, vertical_shift_x, vertical_shift_y):
        super(ParaboloidFilter, self).__init__()
        self.coefficient = coefficient
        self.vertical_shift_x = vertical_shift_x
        self.vertical_shift_y = vertical_shift_y
        self.horizontal_shift_x = horizontal_shift_x
        self.horizontal_shift_y = horizontal_shift_y


    # Paraboloid filter function
    def is_included(self, point, ix, iy, iz):
        z_paraboloid_x = (self.coefficient * ((ix + self.vertical_shift_x) ** 2 + (iy + self.vertical_shift_y) ** 2)) + self.horizontal_shift_x
        z_paraboloid_y = (self.coefficient * ((iy + self.vertical_shift_x) ** 2 + (ix + self.vertical_shift_x) ** 2)) + self.horizontal_shift_y
    
        # Check if the z value of the point is less than or equal to the z value of the paraboloid
        return z_paraboloid_x > iz < z_paraboloid_y

pfilter = ParaboloidFilter(coefficient=0.2, vertical_shift_x= -4, vertical_shift_y=4, horizontal_shift_x=0, horizontal_shift_y=1)
# ---------- end parab_filter ----------
value_list = ValueList({"Modulo filter": 0, "Random filter": 1, "Linear filter": 2, "Paraboloid filter": 3}, selected="Linear filter")
stream_filter = StreamFilter(Gate=value_list, Stream0=modulo_filter, Stream1=random_filter, Stream2=linear_filter, Stream3=parab_filter)

# ----
# Applying classes to create buildings
# Create building grid class
define_buildinggrid_class = Python3Script()  # -> BuildingGrid
# ---------- define_buildinggrid_class: Python ----------
# r: compas
# venv: ca-hs26

from compas.geometry import Box
from compas.geometry import Frame
from compas.geometry import Line
from compas.geometry import Vector, Point
from compas.datastructures import VolMesh
from compas.tolerance import TOL


# Instead of a simple list of points
# We will now create a class that contains both data (attributes)
# of our grid and also its behavior (methods)
class BuildingGrid:
    def __init__(self, xsize, ysize, zsize, nx, ny, nz, selected_filter):
        self.volmesh = self.create_volmesh(selected_filter, xsize, ysize, zsize, nx, ny, nz)
        self.columns = []
        self.main_beams = []

    # Create column boxes on vertical edges.
    def generate_columns(self, column_width_x, column_depth_y):
        self.column_width_x = column_width_x
        self.column_depth_y = column_depth_y
        
        # First reset the list of columns
        self.columns = []

        # Now generate columns
        for uv in self.volmesh.edges():
            # If the edge vector is parallel to unit vector Z...
            edge_vector = self.volmesh.edge_direction(uv)

            if edge_vector.dot(Vector.Zaxis()) in (1, -1):
                # ...we add a column
                edge_midpoint = self.volmesh.edge_point(uv)
                edge_length = self.volmesh.edge_length(uv)

                column = Box(column_width_x, column_depth_y, edge_length)
                column.frame.point = edge_midpoint
                self.columns.append(column)

    # This method is provided as is
    # It shows how to create main beams
    # Main beams are a bit more complicated than columns
    # because they need to be adjusted in length to match the column
    def generate_main_beams(self, main_beam_width, main_beam_height):
        self.main_beams = []
        for uv in self.volmesh.edges():
            edge_vector = self.volmesh.edge_direction(uv)

            if edge_vector.dot(Vector.Zaxis()) == 0:

                start, end = self.volmesh.edge_coordinates(uv)
                line = Line(start, end)
                
                # Shorten the beam to fit the columns
                if edge_vector.dot(Vector.Xaxis()) in (1, -1):
                    shift_value = self.column_width_x
                else:
                    shift_value = self.column_depth_y
                
                # Create the box in the origin of world XY frame
                mainbeam = Box.from_width_height_depth(main_beam_width, main_beam_height, line.length - shift_value)
                frame = Frame(line.midpoint, edge_vector.cross(Vector.Zaxis()), edge_vector)
                frame.point.z -= main_beam_height / 2
        
                # Move box to correct frame
                mainbeam.frame = frame

                self.main_beams.append(mainbeam)


    def number_of_columns(self):
        return len(self.columns)
    
    def number_of_main_beams(self):
        return len(self.main_beams)

    def calculate_volume(self):
        # Sum of member volumes; overlapping regions are not subtracted.
        return sum(box.volume for box in self.columns + self.main_beams)
        

    def create_volmesh(self, selected_filter, xsize, ysize, zsize, nx, ny, nz):
        volmesh = VolMesh()
        vertex_keys = dict()

        for ix in range(nx):
            for iy in range(ny):
                for iz in range(nz):
                    corner_1 = Point(ix * xsize, iy * ysize, iz * zsize)
                    corner_2 = Point(corner_1.x + xsize, corner_1.y + ysize, corner_1.z)
                    
                    # Only add cell if within filter
                    if selected_filter.is_included(corner_1, ix, iy, iz):
                        box = Box.from_corner_corner_height(corner_1, corner_2, zsize)
                        corner_points = box.compute_vertices()
                        vertices = []
                        for v in corner_points:
                            gkey = TOL.geometric_key(v)
                            if gkey not in vertex_keys:
                                vertex_keys[gkey] = volmesh.add_vertex(x=v.x, y=v.y, z=v.z)

                            vertices.append(vertex_keys[gkey])

                        a, b, c, d, e, f, g, h = vertices
                        faces = [
                            [a, b, c, d],  # bottom face
                            [a, d, f, e],  # front face
                            [a, e, h, b],  # left face
                            [b, h, g, c],  # back face
                            [c, g, f, d],  # right face
                            [e, f, g, h],  # top face
                        ]

                        # Add the cell with the defined faces
                        volmesh.add_cell(faces, attr_dict=dict(ix=ix, iy=iy, iz=iz))

        return volmesh
# ---------- end define_buildinggrid_class ----------
buildinggrid = Data(define_buildinggrid_class)

# ---- group: Grid size
number_slider = Slider(9, range=0..20)
number_slider_2 = Slider(9, range=0..20)
number_slider_3 = Slider(9, range=0..20)

# ---- group: Cell sizes
number_slider_4 = Slider(5, range=0..20)
number_slider_5 = Slider(3.5, range=0..20)
number_slider_6 = Slider(4.5, range=0..20)

# ---- group: Options
main_beam_height = Slider(0.4, range=0.1..0.9)
column_width_x = Slider(0.35, range=0.1..0.9)
column_depth_y = Slider(0.45, range=0.1..0.9)
main_beam_width = Slider(0.35, range=0.1..0.9)

# ----
# Create instance of building grid
buildinggrid_2 = Data(buildinggrid)
filter = Data(stream_filter)
grid = Python3Script(
    BuildingGrid=buildinggrid_2,
    selected_filter=filter,
    nx=number_slider,
    ny=number_slider_2,
    nz=number_slider_3,
    xsize=number_slider_4,
    ysize=number_slider_6,
    zsize=number_slider_5,
    main_beam_width=main_beam_width,
    main_beam_height=main_beam_height,
    column_width_x=column_width_x,
    column_depth_y=column_depth_y)  # -> grid; inputs nx: Int32, ny: Int32, nz: Int32
# ---------- grid: Python ----------
# r: compas
# venv: ca-hs26

# Same constructor as the starter and the following slab assignment.
grid = BuildingGrid(xsize, ysize, zsize, nx, ny, nz, selected_filter)
grid.generate_columns(column_width_x, column_depth_y)
grid.generate_main_beams(main_beam_width, main_beam_height)
# ---------- end grid ----------

# ---- group: Cells
# Visualization
number_slider_7 = Slider(0, range=0..1161)
cells = Python3Script(i=number_slider_7, grid=grid)  # -> cells
# ---------- cells: Python ----------
# r: compas
# venv: ca-hs26

from compas_rhino.conversions import mesh_to_rhino

cells = []
for x in grid.volmesh.cells():
    if x < i:
        cells.append(mesh_to_rhino(grid.volmesh.cell_to_mesh(x)))
# ---------- end cells ----------
custom_preview = CustomPreview(Geometry=cells, Material=ColourSwatch(SwatchColor=RGBA(41, 115, 111, 124)))

# ---- group: Columns
columns = Python3Script(grid=grid)  # -> columns
# ---------- columns: Python ----------
# r: compas
# venv: ca-hs26

# We use this direct conversion instead of the component
# because we want the Box BREP instead of the meshes
from compas_rhino.conversions import box_to_rhino

columns = []

for column in grid.columns:
    column = box_to_rhino(column)
    columns.append(column)
# ---------- end columns ----------
custom_preview_2 = CustomPreview(Geometry=columns, Material=ColourSwatch(SwatchColor=RGBA(115, 41, 41, 124)))

# ---- group: Main beams
main_beams = Python3Script(grid=grid)  # -> mainbeams
# ---------- main_beams: Python ----------
# r: compas
# venv: ca-hs26

# We use this direct conversion instead of the component
# because we want the Box BREP instead of the meshes
from compas_rhino.conversions import box_to_rhino

mainbeams = []

for mainbeam in grid.main_beams:
    b = box_to_rhino(mainbeam)
    mainbeams.append(b)
# ---------- end main_beams ----------
custom_preview_3 = CustomPreview(Geometry=main_beams, Material=ColourSwatch(SwatchColor=RGBA(252, 129, 35, 156)))
