# Grasshopper definition 01-building-grid-facade_hs26.gh (Grasshopper 1.0.8)

# ----
# Geometry Pipeline
geometry_pipeline = GeometryPipeline(
    GroupByLayer=False,
    GroupByType=False,
    IncludeHidden=True,
    IncludeLocked=True,
    LayerFilter="Geometric_Filter",
    NameFilter="*",
    SublayerFiltering=True,
    TypeFilter=1073741848)
sunion = SolidUnion(Breps=geometry_pipeline)

# ----
# Applying classes to create buildings
define_buildinggrid_class = Python3Script()  # -> BuildingGrid
# ---------- define_buildinggrid_class: Python ----------
# r: compas
# venv: ca-hs26

from compas.geometry import Box
from compas.geometry import Frame
from compas.geometry import Line
from compas.geometry import Vector, Point
from compas.datastructures import VolMesh
from compas.tolerance import TOL


# NOTE: We have introduced these simple classes to carry a bit of additional information beyond just geometry!
class MainBeam:
    def __init__(self, geometry, edge):
        self.geometry = geometry
        self.edge = edge


class Column:
    def __init__(self, geometry, edge):
        self.geometry = geometry
        self.edge = edge


class Slab:
    def __init__(self, geometry, halfface, category="floor_slab"):
        self.geometry = geometry
        self.halfface = halfface
        self.category = category

# TUTORIAL WEEK-09: Facades
# .. add your code here ..


# Instead of a simple list of points
# We will now create a class that contains both data (attributes)
# of our grid and also its behavior (methods)
class BuildingGrid:
    def __init__(self, xsize, ysize, zsize, nx, ny, nz, selected_filter):
        self.volmesh = self.create_volmesh(selected_filter, xsize, ysize, zsize, nx, ny, nz)
        self.columns = []
        self.main_beams = []
        self.slabs = []
        self.walls = []

    def number_of_columns(self):
        return len(self.columns)
    
    def number_of_main_beams(self):
        return len(self.main_beams)

    def calculate_volume(self):
        pass

    # TUTORIAL WEEK-09: Facades
    def generate_facades(self, facade_thickness):
        pass
        # 1. Reset the list of walls
        # ... your code here ...

        # 2. For each face in the volmesh
        # ... your code here ...
            
            # 3. Check if it's in on boundary, otherwise continue to the next face
            # ... your code here ...

            # 4. Get the normal of the face
            # ... your code here ...

            # 5. Calculate the dot product to the unit vector Z
            # ... your code here ...
            
            # 6. If the dot product is zero
            #    .. (ie. the normal is perpendicular to Z -> the face is a vertical one)
            # ... your code here ...

                # 7. Get face points and centroid
                # ... your code here ...

                # 8. Determine width & depth. If the face normal
                #    .. is perpendicular to the Y axis vector,
                #    .. width is along Y, else, it is along X
                #    .. depth will be the difference along Z
                # ... your code here ...

                # 9. Create a box from width, height and depth
                # ... your code here ...

                # 10. Adjust xsize and ysize of geometry to fit based
                #     .. on column_depth_y/column_width_x/main_beam_height
                # ... your code here ...

                # 11. Calculate the xaxis and yaxis for the box's frame based
                #     .. on the normal of the face
                # ... your code here ...

                # 12. Classify outward normals: North=+Y, East=+X, South=-Y, West=-X
                # ... your code here ...

                # 13. Append box to list
                # ... your code here ...
                
    # END TUTORIAL WEEK-09: Facades

    # Use your solution from A03 here
    def generate_slabs(self, slab_height):
        pass
        # 1. Reset slabs list to an empty list
        # ... your code here ...

        # 2. Iterate: for each face in the volmesh (hint: faces() of volmesh)
        # ... your code here ...

            # 3. Get the normal of the half-face (hint: face_normal() of volmesh)
            # ... your code here ...

            # 4. Calculate dot product of the face normal to the Z axis vector
            #    if it's parallel to the unit Z axis, we will add a slab
            # ... your code here ...
                
                # 5. Find the points of the face (hint: face_points() of volmesh)
                # ... your code here ...

                # 6. Create a box from a diagonal between one corner and the opposite corner shifted by slab_height in Z
                #    (hint: use Box.from_diagonal with Line and Point)
                # ... your code here ...
                
                # 6. Create an instance of the slab class you created above
                # ... your code here ...

                # 7. Append it to the grid.slabs attribute list
                # ... your code here ...

    def generate_columns(self, column_width_x, column_depth_y):
        self.column_width_x = column_width_x
        self.column_depth_y = column_depth_y
        
        # First reset the list of columns
        self.columns = []

        # Now generate columns
        for uv in self.volmesh.edges():
            # If the edge vector is parallel to unit vector Z...
            edge_vector = self.volmesh.edge_direction(uv)

            if edge_vector.dot(Vector.Zaxis()) in (1, -1):
                # ...we add a column
                edge_midpoint = self.volmesh.edge_point(uv)
                edge_length = self.volmesh.edge_length(uv)

                column = Box(column_width_x, column_depth_y, edge_length)
                column.frame.point = edge_midpoint

                # NOTE: We changed this line to create an instance of Column() to contain geometry + edge info
                self.columns.append(Column(column, uv))

    # This method is provided as is
    # It shows how to create main beams
    # Main beams are a nbit more complicated than columns
    # because they need to be adjusted in length to match the column
    def generate_main_beams(self, main_beam_width, main_beam_height):
        self.main_beams = []
        # NOTE: We need to keep track of main beam dimensions to create our slabs accordingly
        self.main_beam_width = main_beam_width
        self.main_beam_height = main_beam_height

        for uv in self.volmesh.edges():
            edge_vector = self.volmesh.edge_direction(uv)

            if edge_vector.dot(Vector.Zaxis()) == 0:

                start, end = self.volmesh.edge_coordinates(uv)
                line = Line(start, end)
                
                # Shorten the beam to fit the columns
                if edge_vector.dot(Vector.Xaxis()) in (1, -1):
                    shift_value = self.column_width_x
                else:
                    shift_value = self.column_depth_y
                
                # Create the box in the origin of world XY frame
                mainbeam = Box.from_width_height_depth(main_beam_width, main_beam_height, line.length - shift_value)
                frame = Frame(line.midpoint, edge_vector.cross(Vector.Zaxis()), edge_vector)
                frame.point.z -= main_beam_height / 2
        
                # Move box to correct frame
                mainbeam.frame = frame

                # NOTE: We changed this line to create an instance of MainBeam() to contain geometry + edge info
                self.main_beams.append(MainBeam(mainbeam, uv))

    def create_volmesh(self, selected_filter, xsize, ysize, zsize, nx, ny, nz):
        volmesh = VolMesh()
        vertex_keys = dict()

        for ix in range(nx):
            for iy in range(ny):
                for iz in range(nz):
                    corner_1 = Point(ix * xsize, iy * ysize, iz * zsize)
                    corner_2 = Point(corner_1.x + xsize, corner_1.y + ysize, corner_1.z)
                    
                    # Only add cell if within filter
                    if selected_filter.is_included(corner_1, ix, iy, iz):
                        box = Box.from_corner_corner_height(corner_1, corner_2, zsize)
                        corner_points = box.compute_vertices()
                        vertices = []

                        for v in corner_points:
                            gkey = TOL.geometric_key(v)
                            if gkey not in vertex_keys:
                                vertex_keys[gkey] = volmesh.add_vertex(x=v.x, y=v.y, z=v.z)

                            vertices.append(vertex_keys[gkey])

                        a, b, c, d, e, f, g, h = vertices
                        faces = [
                            [a, b, c, d],  # bottom face
                            [a, d, f, e],  # front face
                            [a, e, h, b],  # left face
                            [b, h, g, c],  # back face
                            [c, g, f, d],  # right face
                            [e, f, g, h],  # top face
                        ]

                        # Add the cell with the defined faces
                        volmesh.add_cell(faces, attr_dict=dict(ix=ix, iy=iy, iz=iz))
        
        return volmesh
# ---------- end define_buildinggrid_class ----------
buildinggrid = Data(define_buildinggrid_class)

# ---- group: Grid size
number_slider = Slider(9, range=0..20)
number_slider_2 = Slider(9, range=0..20)
number_slider_3 = Slider(9, range=0..20)

# ---- group: Cell sizes
number_slider_4 = Slider(5, range=0..20)
number_slider_5 = Slider(4.5, range=0..20)
number_slider_6 = Slider(3.5, range=0..20)

# ---- group: Options
main_beam_width = Slider(0.25, range=0.1..0.9)
main_beam_height = Slider(0.4, range=0.1..0.9)
column_width_x = Slider(0.25, range=0.1..0.9)
column_depth_y = Slider(0.45, range=0.1..0.9)
slab_height = Slider(0.35, range=0.1..0.9)
facade_thickness = Slider(0.25, range=0.1..0.9)

# ----
# Filter Classes
# Filter Selection
# Brep Filter: Use your Brep filter from A02 here!
# Brep Filter: Use your merge filter from A02 here!
modulo_filter = Python3Script()  # -> mfilter
# ---------- modulo_filter: Python ----------
# r: compas
# venv: ca-hs26

# Sample filter
class ModuleBasedFilter(object):
    def is_included(self, point, ix, iy, iz):
        if (ix + iy) % 2 == 0:
            return True

        return False

mfilter = ModuleBasedFilter()
# ---------- end modulo_filter ----------
random_filter = Python3Script()  # -> rfilter
# ---------- random_filter: Python ----------
# r: compas
# venv: ca-hs26

# Sample filter
from random import choice

class RandomFilter(object):
    def is_included(self, point, ix, iy, iz):
        return choice([True, False])

rfilter = RandomFilter()
# ---------- end random_filter ----------
linear_filter = Python3Script()  # -> lfilter
# ---------- linear_filter: Python ----------
# r: compas
# venv: ca-hs26

# Sample filter
class LinearFilter(object):
    def __init__(self, coefficient=1, vertical_shift_x=0, vertical_shift_y=0, horizontal_shift_x=0, horizontal_shift_y=0):
        super(LinearFilter, self).__init__()
        self.coefficient = coefficient
        self.vertical_shift_x = vertical_shift_x
        self.vertical_shift_y = vertical_shift_y
        self.horizontal_shift_x = horizontal_shift_x
        self.horizontal_shift_y = horizontal_shift_y

    def is_included(self, point, ix, iy, iz):
        z_range_x = (self.coefficient * ix + self.vertical_shift_x) + self.horizontal_shift_x
        z_range_y = (self.coefficient * iy + self.vertical_shift_y) + self.horizontal_shift_y
        return not z_range_x < iz > z_range_y

lfilter = LinearFilter(coefficient= 1.7, vertical_shift_x= -3, vertical_shift_y=-3, horizontal_shift_x=0, horizontal_shift_y=0)
# ---------- end linear_filter ----------
bfilter = Python3Script(brep=sunion)  # -> bfilter; inputs brep: Brep
# ---------- bfilter: Python ----------
# r: compas
# venv: ca-hs26

"""
Use your implementation of the Brep Filter from A02 here!
"""

# Copy and Paste your solution from A02 here
# [ADD YOUR CODE HERE...]
# ---------- end bfilter ----------
parab_filter = Python3Script()  # -> pfilter
# ---------- parab_filter: Python ----------
# r: compas
# venv: ca-hs26

# Sample filter
class ParaboloidFilter(object):
    def __init__(self, coefficient, horizontal_shift_x, horizontal_shift_y, vertical_shift_x, vertical_shift_y):
        super(ParaboloidFilter, self).__init__()
        self.coefficient = coefficient
        self.vertical_shift_x = vertical_shift_x
        self.vertical_shift_y = vertical_shift_y
        self.horizontal_shift_x = horizontal_shift_x
        self.horizontal_shift_y = horizontal_shift_y


    # Paraboloid filter function
    def is_included(self, point, ix, iy, iz):
        z_paraboloid_x = (self.coefficient * ((ix + self.vertical_shift_x) ** 2 + (iy + self.vertical_shift_y) ** 2)) + self.horizontal_shift_x
        z_paraboloid_y = (self.coefficient * ((iy + self.vertical_shift_x) ** 2 + (ix + self.vertical_shift_x) ** 2)) + self.horizontal_shift_y
    
        # Check if the z value of the point is less than or equal to the z value of the paraboloid
        return z_paraboloid_x > iz < z_paraboloid_y

pfilter = ParaboloidFilter(coefficient=0.2, vertical_shift_x= -4, vertical_shift_y=4, horizontal_shift_x=0, horizontal_shift_y=1)
# ---------- end parab_filter ----------
value_list = ValueList({"Modulo filter": 0, "Random filter": 1, "Linear filter": 2, "Paraboloid filter": 3, "Brep filter": 4, "Merge filter": 5}, selected="Paraboloid filter")

list = ValueList({"Union": "union", "Intersection": "intersection"}, selected="Intersection")
filter = Python3Script(filter1=parab_filter, filter2=bfilter, mode=list)  # -> mfilter
# ---------- filter: Python ----------
# r: compas
# venv: ca-hs26

"""
Use your implementation of the Merge Filter from A02 here!
"""

# Copy and Paste your solution from A02 here
# [ADD YOUR CODE HERE...]
# ---------- end filter ----------

stream_filter = StreamFilter(
    Gate=value_list,
    Stream0=modulo_filter,
    Stream1=random_filter,
    Stream2=linear_filter,
    Stream3=parab_filter,
    Stream5=filter)

# ----
# Create instance of building grid
buildinggrid_2 = Data(buildinggrid)
filter_2 = Data(stream_filter)
grid = Python3Script(
    BuildingGrid=buildinggrid_2,
    selected_filter=filter_2,
    nx=number_slider,
    ny=number_slider_2,
    nz=number_slider_3,
    xsize=number_slider_4,
    ysize=number_slider_5,
    zsize=number_slider_6,
    main_beam_width=main_beam_width,
    main_beam_height=main_beam_height,
    column_width_x=column_width_x,
    column_depth_y=column_depth_y,
    slab_height=slab_height,
    facade_thickness=facade_thickness)  # -> grid; inputs nx: Int32, ny: Int32, nz: Int32
# ---------- grid: Python ----------
# r: compas
# venv: ca-hs26

# Create an instance of our building grid
grid = BuildingGrid(xsize, ysize, zsize, nx, ny, nz, selected_filter)

grid.generate_columns(column_width_x, column_depth_y)
grid.generate_main_beams(main_beam_width, main_beam_height)
grid.generate_slabs(slab_height)
# ---------- end grid ----------

# ----
# Slab class: Use your code for slab categorization from A03 here
python = Python3Script(grid=grid)  # -> grid
# ---------- python: Python ----------
# r: compas
# venv: ca-hs26

# Use your code for slab categorization from A03 here
# ---------- end python ----------
grid_2 = Data(python)

# ---- group: Cells
# Visualization
number_slider_7 = Slider(0, range=0..1161)
grid_3 = Data(grid_2)
cells = Python3Script(i=number_slider_7, grid=grid_3)  # -> cells
# ---------- cells: Python ----------
# r: compas
# venv: ca-hs26

from compas_rhino.conversions import mesh_to_rhino

cells = []
for x in grid.volmesh.cells():
    if x < i:
        cells.append(mesh_to_rhino(grid.volmesh.cell_to_mesh(x)))
# ---------- end cells ----------
custom_preview = CustomPreview(Geometry=cells, Material=ColourSwatch(SwatchColor=RGBA(41, 115, 111, 124)))

# ---- group: Columns
columns = Python3Script(grid=grid_2)  # -> columns
# ---------- columns: Python ----------
# r: compas
# venv: ca-hs26

# We use this direct conversion instead of the component
# because we want the Box BREP instead of the meshes
from compas_rhino.conversions import box_to_rhino

columns = []

for column in grid.columns:
    column = box_to_rhino(column.geometry)
    columns.append(column)
# ---------- end columns ----------
custom_preview_2 = CustomPreview(Geometry=columns, Material=ColourSwatch(SwatchColor=RGBA(0, 0, 0, 182)))

# ---- group: Main beams
main_beams = Python3Script(grid=grid_2)  # -> mainbeams
# ---------- main_beams: Python ----------
# r: compas
# venv: ca-hs26

# We use this direct conversion instead of the component
# because we want the Box BREP instead of the meshes
from compas_rhino.conversions import box_to_rhino

mainbeams = []

for mainbeam in grid.main_beams:
    b = box_to_rhino(mainbeam.geometry)
    mainbeams.append(b)
# ---------- end main_beams ----------
custom_preview_3 = CustomPreview(Geometry=main_beams, Material=ColourSwatch(SwatchColor=RGB(0, 0, 0)))

# ----
merge = Merge(
    Data1=ColourSwatch(SwatchColor=RGBA(0, 0, 0, 135)),
    Data2=ColourSwatch(SwatchColor=RGBA(41, 41, 41, 205)),
    Data3=ColourSwatch(SwatchColor=RGBA(0, 0, 0, 200)))
slabs = Python3Script(grid=grid_2, available_colors=merge)  # -> slabs, colors; inputs available_colors: list
# ---------- slabs: Python ----------
# r: compas
# venv: ca-hs26

# We use this direct conversion instead of the component
# because we want the Box BREP instead of the meshes
from compas_rhino.conversions import box_to_rhino

slabs = []
colors = []

for slab in grid.slabs:
    box = box_to_rhino(slab.geometry)
    
    if slab.category == "roof":
        colors.append(available_colors[0])
    elif slab.category == "bottom_slab":
        colors.append(available_colors[1])
    elif slab.category == "floor_slab":
        colors.append(available_colors[2])
        
    slabs.append(box)
# ---------- end slabs ----------
custom_preview_4 = CustomPreview(Geometry=slabs.slabs, Material=slabs.colors)  # disabled

facades = Script(grid=grid_2)  # -> facades
# ---------- facades: Python ----------
# We use this direct conversion instead of the component
# because we want the Box BREP instead of the meshes
from compas_rhino.conversions import box_to_rhino

facades = []

for wall in grid.walls:
    b = box_to_rhino(wall.geometry)
    facades.append(b)
# ---------- end facades ----------
custom_preview_5 = CustomPreview(Geometry=facades, Material=ColourSwatch(SwatchColor=RGBA(122, 35, 252, 156)))

# ---- group: Attractor-based coloring
attractor_curve = Curve()  # disabled
facades_2 = Script(grid=grid_2, attractor_curve=attractor_curve)  # -> facades, distances; inputs attractor_curve: Curve; disabled
# ---------- facades_2: Python ----------
import math
from compas_rhino.conversions import box_to_rhino
from compas_rhino.conversions import curve_to_compas
from compas.geometry import distance_point_point
from compas.geometry import Rotation

# 1. Reference the curve from Rhino/Grasshopper and convert to COMPAS
# .. add your code here..

# 2. Create two empty lists for facades (boxes) and distances
# .. add your code here..

# 3. For each facade wall
# .. add your code here..

    # 4. Let's create an alias to the frame of the wall's shape (box)
    # .. because we are lazy to type too much ;)
    # .. add your code here..

    # 5. Calculate the closest point on curve from the centroid of the box (hint: .closest_point() of Curve)
    # .. add your code here..
    
    # 6. Calculate distance to the centroid of the box (hint: .distance_to_point() of Point)
    # .. add your code here..

    # 7. Append to list of distances
    # .. add your code here..

    # 8. Copy the shape (box)
    # WHY? Because we will rotate it. If we don't copy, the next time we run this script,
    # .. it will rotate again over the previous rotation!
    # .. add your code here..
   
    # 9. Let's make only the South (-Y) facade be modified by the attractor
    # .. add your code here..

        # 10. Calculate some rotation value
        # You can play around with how to calculate a value that produces nice results
        # .. add your code here..
        
        # 11. Create a Rotation object from axis and angle values.
        # The axis coud be X or Y axis of the box's frame, the angle value is what we calculated above
        # We also need to rotate around the centroid of the box (otherwise it rotates around 0, 0, 0)
        # .. add your code here..

        # 12. Finally, we transform the box frame with our rotation and re-assign it
        # .. add your code here..

    # 13. Append the shape to converted to a rhino box
    # .. add your code here..
# ---------- end facades_2 ----------
bounds = Bounds(Numbers=facades_2.distances)  # disabled
deconstruct_domain = DeconstructDomain(Domain=bounds)  # -> Start, End; disabled
gradient = Gradient(
    LowerLimit=deconstruct_domain.Start,
    UpperLimit=deconstruct_domain.End,
    Parameter=facades_2.distances,
    stops=[0.103: RGB(50, 50, 50), 0.628: RGB(190, 190, 190)])  # disabled
custom_preview_6 = CustomPreview(Geometry=facades_2.facades, Material=gradient)  # disabled
