# Grasshopper definition attractors_hs26.gh (Grasshopper 1.0.8)

# ---- group: Attractor point
point = Point(Point(3.172318315, 2.028027503, 0))

# ---- group: Generate boxes based on attractor
boxes = Python3Script(point=point)  # -> boxes; inputs point: Point3d
# ---------- boxes: Python ----------
# r: compas
# venv: ca-hs26

from compas.geometry import Box
from compas.geometry import Point
from compas_rhino.conversions import point_to_compas

# 1. Get the point from Rhino and convert to COMPAS (hint: function point_to_compas())
# ..

# 2. Create an empty list for the boxes
# ..

# 3. Create a grid using a nested for loop of two range() functions
# .. or use cartesian product of the two range() functions
# ..

        # 4. Create a point at x, y and use 0 for z
        # ..
        
        # 5. Calculate the distance from the attractor point
        # .. to the one just created above (hint: points have a method called .distance_to_point())
        # ..

        # 6. Calculate the size of the box using distance multipled by some factor of your choice
        # ..

        # 7. Create a box using the size
        # ..

        # 8. Assign the point of the box's frame to the point you have created above
        # ..
        
        # 9. Append to the list of boxes
        # ..
# ---------- end boxes ----------

# ----
draw = Python3Script(cg=boxes)  # -> rg
#   port cg: The COMPAS geometry or datastructure to be drawn.
# ---------- draw: Python ----------
# r: compas
# venv: ca-hs26

from compas_rhino.conversions import box_to_rhino
rg = box_to_rhino(cg) if cg is not None else None
# ---------- end draw ----------
