# Grasshopper definition comparing-building-blocks_hs26.gh (Grasshopper 1.0.8)

# ---- group: Values
# Comments in GH can be written
# using the "Scribble" component
integer = Integer(42)
number = Number(3.14)
boolean = Boolean(True)
panel = Panel(integer)
panel_2 = Panel(number)
panel_3 = Panel(boolean)
panel_4 = Panel("Hello World")

# ---- group: Arithmetic operator
addition = Addition(A="42", B="10")
panel_5 = Panel(addition)

# ---- group: Lists
series = Series(Start=0, Step=1, Count=4)
data = Data(["42", "10"])
panel_6 = Panel(data)
panel_7 = Panel(series)

# ---- group: Equivalents of variables in GH
# Parameters are equivalent
# to variables in Python
panel_8 = Panel("42")
addition_2 = Addition(A=panel_8, B="10")
# Naming relays and data components
# is also equivalent to variables
result = Data(addition_2)
panel_9 = Panel(result)

# ---- group: Small algorithm to calculate absolute values
smaller_than = SmallerThan(FirstNumber="-42", SecondNumber="0")  # -> SmallerThan, OrEqualTo
sift_pattern = SiftPattern(List="-42", SiftPattern=smaller_than.SmallerThan)  # -> Output0, Output1
multiplication = Multiplication(A=sift_pattern.Output1, B="-1")
combine_data = CombineData(Input0=sift_pattern.Output0, Input1=multiplication)  # -> Result, Index
panel_10 = Panel(combine_data.Result)

# ---- group: Re-usable building blocks: the built-in abs component that already wraps the previous algorithm
absolute = Absolute(Value="-42")
panel_11 = Panel(absolute)

# ---- group: Re-usable building blocks: wrap custom algorithm into a cluster
cluster = Cluster(value="-42")
cluster_2 = Cluster(value="42")
panel_12 = Panel(cluster)
panel_13 = Panel(cluster_2)

# ----
# # In a line of code,
# # everything after the hash is a comment
# 42                                  # integer value
# 3.14                                # float value
# True                                # boolean value
# "Hello World"                       # string value
python_3_script = Python3Script()  # -> out, a
# ---------- python_3_script: Python ----------
42                                  # integer value
3.14                                # float value
True                                # boolean value
"Hello World"                       # string value

# If we don't do anything with these values, they won't even be printed
# Let's print them at least
print(42)
print(3.14)
print(True)
print("Hello World")
# ---------- end python_3_script ----------
# [42, 10]                            # explicit list of integers
# 
# 
# range(0, 4)                         # computed list of integers
python_3_script_2 = Python3Script()  # -> out, a
# ---------- python_3_script_2: Python ----------
[42, 10]                            # explicit list of integers
range(0, 4)                         # computed list of integers


print([42, 10])
print(range(0, 4))
# ---------- end python_3_script_2 ----------
# 42 + 10                             # expression that produces the value '52' using the + arithmetic operator
python_3_script_3 = Python3Script()  # -> out, a
# ---------- python_3_script_3: Python ----------
42 + 10                             # expression that produces the value '52' using the + arithmetic operator

print(42 + 10)
# ---------- end python_3_script_3 ----------
# result = 42 + 10                    # variable 'result' that contains the value '52'
# # The absolute value algorithm is simple enough to fit in few lines of code
# 
# if value < 0:                       # conditional statement: executes different code depending on a condition
#     print(value * -1)
# else:
#     print(value)
python_3_script_4 = Python3Script()  # -> out, result
# ---------- python_3_script_4: Python ----------
result = 42 + 10                    # variable 'result' that contains the value '52'

# The result will be printed and will ALSO be assigned
# to the output parameter 'result' because names match
print(result)
# ---------- end python_3_script_4 ----------
# print(abs(value))                   # use abs() built-in function
panel_14 = Panel("-42")
python_3_script_5 = Python3Script(value="-42")  # -> out, a; inputs value: Int32
# ---------- python_3_script_5: Python ----------
if value < 0:                       # combine conditional statement, operators and prints to create the abs() algorithm
    print(value * -1)
else:
    print(value)
# ---------- end python_3_script_5 ----------
python_3_script_6 = Python3Script(value=panel_14)  # -> out, a; inputs value: Int32
# ---------- python_3_script_6: Python ----------
print(abs(value))                   # use abs() built-in function
# ---------- end python_3_script_6 ----------
panel_15 = Panel(python_3_script.out)
panel_16 = Panel(python_3_script_2.out)
panel_17 = Panel(python_3_script_3.out)
panel_18 = Panel(python_3_script_4.out)
panel_19 = Panel(python_3_script_4.result)
panel_20 = Panel(python_3_script_5.out)
panel_21 = Panel(python_3_script_6.out)

# ----
# def abs(value):                     # function (aka definition)
#     if value < 0:                   # .. wraps an algorithm in a
#         return value * -1           # .. reusable building block
#     else:
#         return value
panel_22 = Panel("-42")

python_3_script_7 = Python3Script(x=panel_22)  # -> out, a; inputs x: Int32
# ---------- python_3_script_7: Python ----------
def abs(value):                     # function (aka definition)
    if value < 0:                   # .. wraps an algorithm in a
        return value * -1           # .. reusable building block
    else:
        return value

print(abs(x))
# ---------- end python_3_script_7 ----------
python_3_script_8 = Python3Script(x="42")  # -> out, a; inputs x: Int32; same code as python_3_script_7

panel_23 = Panel(python_3_script_7.out)
panel_24 = Panel(python_3_script_8.out)

# ==== cluster Cluster
value = ClusterInput()
smaller_than = SmallerThan(FirstNumber=value, SecondNumber="0")  # -> SmallerThan, OrEqualTo
sift_pattern = SiftPattern(List=value, SiftPattern=smaller_than.SmallerThan)  # -> Output0, Output1
multiplication = Multiplication(A=sift_pattern.Output1, B="-1")
combine_data = CombineData(Input0=sift_pattern.Output0, Input1=multiplication)  # -> Result, Index
result = ClusterOutput(combine_data.Result)
